# Grasshopper definition quick_start.ghx (Grasshopper 1.0.8)
# plug-ins: Form Flux

density = ValueList({"%0": 0, "%10": 10, "%25": 25, "%50": 50, "%75": 75, "%100": 100}, selected="%10")
building_type = ValueList({"Courtyard": 0, "Linear": 1, "Point": 2, "L-shape": 3, "U-shape": 4}, selected=["Courtyard", "Linear", "Point", "L-shape", "U-shape"])

# ---- group: Generate
seed = Slider(48, range=0..100)

# ----
tree_config = TreeConfig(
    TreeDensity=density,
    MinDiameter=Slider(3, range=0..10),
    MaxDiameter=Slider(6, range=0..10),
    GenerateInCourtyards=Toggle(False))

# ---- group: Boundary
reference_boundary = Curve(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)

# ----
sun_position = MDSlider(
    SliderMode=0,
    slider_value=Point(0.8407958426, 0.4417002608, 0.5),
    x_domain=Domain(0, 1),
    y_domain=Domain(0.5, 1),
    z_domain=Domain(0, 1))
form_flux = FormFlux(
    Boundary=reference_boundary,
    Setback=3,
    BuildingDepth=12,
    MinFootprintArea=100,
    Floors_min=3,
    Floors_max=6,
    FloorHeight=4,
    Divisions=Slider(6, range=0..10),
    StreetWidth=2,
    BuildingTypes=building_type,
    NumParks=2,
    GenerateFloorSlabs=False,
    Trees=tree_config,
    Seed=seed)  # -> Footprints, Masses, Heights, Streets, FloorSlabs, Parks, Courtyards, Trees, Parcels, Metrics
shadow = Shadow(mesh=form_flux.Masses, content=form_flux.Masses, uv_point=sun_position)
boundary_surfaces = BoundarySurfaces(Edges=form_flux.Parcels)
surface = Surface(form_flux.Parks)

# ---- group: Trees
custom_preview = CustomPreview(Geometry=form_flux.Trees, Material=ColourSwatch(SwatchColor=RGB(255, 255, 255)))

# ---- group: Parks
custom_preview_2 = CustomPreview(Geometry=surface, Material=ColourSwatch(SwatchColor=RGB(129, 166, 151)))

# ---- group: Parcels
custom_preview_3 = CustomPreview(Geometry=boundary_surfaces, Material=ColourSwatch(SwatchColor=RGB(232, 232, 232)))

# ---- group: Shadow
custom_preview_4 = CustomPreview(Geometry=shadow, Material=ColourSwatch(SwatchColor=RGB(0, 0, 0)))

# ---- group: Buildings
custom_preview_5 = CustomPreview(Geometry=form_flux.Masses, Material=ColourSwatch(SwatchColor=RGB(150, 150, 150)))

# ==== cluster Shadow
mesh = ClusterInput()
uv_point = ClusterInput()
content = ClusterInput()
bounding_box = BoundingBox(Content=content, Plane=PlaneXY(0, 0, 0), UnionBox=True)  # -> Box, Box_2
deconstruct_brep = DeconstructBrep(Brep=bounding_box.Box)  # -> Faces, Edges, Vertices
list_item = ListItem(List=deconstruct_brep.Faces, Index=4, Wrap=True)
area = Area(Geometry=list_item)  # -> Area, Centroid
square_root = SquareRoot(Value=area.Area)
sphere = Sphere(Base=area.Centroid, Radius=square_root)
project = Project(Geometry=sphere, Plane=PlaneXY(0, 0, 0))  # -> Geometry, Transform
split_brep = SplitBrep(Brep=sphere, Cutter=project.Geometry)
list_item_2 = ListItem(List=split_brep, Index=0, Wrap=True)
iso_curve = IsoCurve(Surface=reparameterize(list_item_2), UVPoint=uv_point)  # -> UIsocurve, VIsocurve
custom_preview = CustomPreview(Geometry=list_item_2, Material=ColourSwatch(SwatchColor=RGBA(255, 255, 255, 0)))
curve_curve = CurveCurve(CurveA=iso_curve.UIsocurve, CurveB=iso_curve.VIsocurve)  # -> Points, ParamsA, ParamsB
mesh_shadow = MeshShadow(Mesh=mesh, Light=curve_curve.Points, Plane=PlaneXY(0, 0, 0.1))
surface = Surface(mesh_shadow)
surface_2 = ClusterOutput(surface)
