# Grasshopper definition quick_start.ghx (Grasshopper 1.0.8)
# plug-ins: Meta Form

number_slider = Slider(23, range=0..100)
number_slider_2 = Slider(40, range=0..100)
point_config = PointConfig(
    MinFloors=3,
    MaxFloors=6,
    Radius=0,
    MinArea=100,
    MinSetback=3,
    MaxSetback=3,
    MinDepth=number_slider_2,
    MaxDepth=number_slider_2)
tall_building_config = TallBuildingConfig(
    MinFloors=Slider(17, range=0..100),
    MaxFloors=Slider(38, range=0..100),
    Radius=Slider(0, range=0..10),
    MinArea="1000",
    MinSetback=3,
    MaxSetback=3,
    MinDepth=12,
    MaxDepth=12)
u_shape_config = UShapeConfig(
    MinFloors=3,
    MaxFloors=6,
    Radius=0,
    MinArea=100,
    MinSetback=3,
    MaxSetback=3,
    MinDepth=12,
    MaxDepth=Slider(68, range=0..100))
courtyard_config = CourtyardConfig(
    MinFloors=3,
    MaxFloors=6,
    Radius=Slider(0, range=0..100),
    MinArea=100,
    MinSetback=3,
    MaxSetback=3,
    MinDepth=12,
    MaxDepth=Slider(21, range=0..100))
linear_config = LinearConfig(
    MinFloors=Slider(11, range=0..100),
    MaxFloors=Slider(18, range=0..100),
    Radius=0,
    MinArea=100,
    MinSetback=3,
    MaxSetback=3,
    MinDepth=12,
    MaxDepth=12)
l_shape_config = LShapeConfig(
    MinFloors=3,
    MaxFloors=6,
    Radius=0,
    MinArea=100,
    MinSetback=3,
    MaxSetback=3,
    MinDepth=number_slider,
    MaxDepth=number_slider)
merge = Merge(
    Data1=point_config,
    Data2=tall_building_config,
    Data3=u_shape_config,
    Data4=courtyard_config,
    Data5=linear_config,
    Data6=l_shape_config)
density = ValueList({"%0": 0, "%10": 10, "%25": 25, "%50": 50, "%75": 75, "%100": 100}, selected="%10")

# ---- group: Generate
seed = Slider(50, range=0..100)

# ----
tree_config = TreeConfig(
    TreeDensity=density,
    MinDiameter=Slider(3, range=0..10),
    MaxDiameter=Slider(6, range=0..10),
    GenerateInCourtyards=Toggle(False))

# ---- group: Boundary
reference_boundary = Curve(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)

# ----
meta_form = MetaForm(
    Boundary=reference_boundary,
    FloorHeight=4,
    Divisions=Slider(5, range=0..10),
    StreetWidth=Slider(7, range=0..10),
    BuildingConfigs=merge,
    NumParks="6",
    GenerateFloorSlabs=False,
    Trees=tree_config,
    Seed=seed)  # -> Footprints, Masses, Heights, Streets, FloorSlabs, Parks, Courtyards, Trees, Parcels, Metrics
sun_position = MDSlider(
    SliderMode=0,
    slider_value=Point(0.51191423, 0.6604431897, 0.5),
    x_domain=Domain(0, 1),
    y_domain=Domain(0.5, 1),
    z_domain=Domain(0, 1))
shadow = Shadow(mesh=meta_form.Masses, content=meta_form.Masses, uv_point=sun_position)
panel = Panel(meta_form.Metrics)
boundary_surfaces = BoundarySurfaces(Edges=meta_form.Parcels)
surface = Surface(meta_form.Parks)

# ---- group: Trees
custom_preview = CustomPreview(Geometry=meta_form.Trees, Material=ColourSwatch(SwatchColor=RGB(255, 255, 255)))

# ---- group: Parks
custom_preview_2 = CustomPreview(Geometry=surface, Material=ColourSwatch(SwatchColor=RGB(129, 166, 151)))

# ---- group: Parcels
custom_preview_3 = CustomPreview(Geometry=boundary_surfaces, Material=ColourSwatch(SwatchColor=RGB(232, 232, 232)))

# ---- group: Shadow
custom_preview_4 = CustomPreview(Geometry=shadow, Material=ColourSwatch(SwatchColor=RGB(0, 0, 0)))

# ---- group: Buildings
custom_preview_5 = CustomPreview(Geometry=meta_form.Masses, Material=ColourSwatch(SwatchColor=RGB(150, 150, 150)))

# ==== cluster Shadow
content = ClusterInput()
bounding_box = BoundingBox(Content=content, Plane=PlaneXY(0, 0, 0), UnionBox=True)  # -> Box, Box_2
deconstruct_brep = DeconstructBrep(Brep=bounding_box.Box)  # -> Faces, Edges, Vertices
list_item = ListItem(List=deconstruct_brep.Faces, Index=4, Wrap=True)
area = Area(Geometry=list_item)  # -> Area, Centroid
square_root = SquareRoot(Value=area.Area)
sphere = Sphere(Base=area.Centroid, Radius=square_root)
project = Project(Geometry=sphere, Plane=PlaneXY(0, 0, 0))  # -> Geometry, Transform
split_brep = SplitBrep(Brep=sphere, Cutter=project.Geometry)
uv_point = ClusterInput()
list_item_2 = ListItem(List=split_brep, Index=0, Wrap=True)
iso_curve = IsoCurve(Surface=reparameterize(list_item_2), UVPoint=uv_point)  # -> UIsocurve, VIsocurve
custom_preview = CustomPreview(Geometry=list_item_2, Material=ColourSwatch(SwatchColor=RGBA(255, 255, 255, 0)))
curve_curve = CurveCurve(CurveA=iso_curve.UIsocurve, CurveB=iso_curve.VIsocurve)  # -> Points, ParamsA, ParamsB
mesh = ClusterInput()
mesh_shadow = MeshShadow(Mesh=mesh, Light=curve_curve.Points, Plane=PlaneXY(0, 0, 0.1))
surface = Surface(mesh_shadow)
surface_2 = ClusterOutput(surface)
